# Grasshopper definition dfCutFillInPath.gh (Grasshopper 1.0.7)
# plug-ins: Docofossor

# Docofossor
# Cut and Fill in Path
# link to: /example_DTM.xyz
path = FilePath()
dfimportxyz = ImportXYZ(MarshallingSignalParameter=path)
crv = Curve(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)
dfcutfillinpath = CutFillInPath(Df=dfimportxyz, Crv=crv, W="5")  # -> Df, Vol
dfgridmesh = GridMesh(Df=dfcutfillinpath.Df)
