# Grasshopper definition dfCutFillInSurface.gh (Grasshopper 1.0.7)
# plug-ins: Docofossor

# Docofossor
# Cut On Path
# link to: /example_DTM.xyz
path = FilePath()
dfimportxyz = ImportXYZ(MarshallingSignalParameter=path)
crv = Curve(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)
dfcutonpath = CutOnPath(Df=dfimportxyz, Crv=crv, Mxd="2", W="10")  # -> Df, Vol
dfgridmesh = GridMesh(Df=dfcutonpath.Df)
