# Grasshopper definition dfExportXYZ.gh (Grasshopper 1.0.7)
# plug-ins: Docofossor

# set to: /examples/example_DTM.xyz
path = FilePath("C:\Users\ARCH-GIROT-W-01\Dropbox\CODE\docofossor\examples\example_DTM.xyz")
dfimportxyz = ImportXYZ(MarshallingSignalParameter=path)
dfexportxyz = ExportXYZ(Df=dfimportxyz, F="filename", W=Button())
