# Grasshopper definition dfGridFilter.gh (Grasshopper 1.0.7)
# plug-ins: Docofossor

# Docofossor
# Gird Filter
# link to: /example_DTM.xyz
path = FilePath()
dfimportxyz = ImportXYZ(MarshallingSignalParameter=path)
dfgridfilter = GridFilter(Df=dfimportxyz, N="4")
dfgridmesh = GridMesh(Df=dfgridfilter)
