# Grasshopper definition dfNoise.gh (Grasshopper 1.0.7)
# plug-ins: Docofossor

# Docofossor
# Noise
# link to: /example_DTM.xyz
path = FilePath()
dfimportxyz = ImportXYZ(MarshallingSignalParameter=path)
crv = Curve(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)
dfnoise = Noise(Df=dfimportxyz, Crv=crv, Wl="4", A="2")
dfgridmesh = GridMesh(Df=dfnoise)
