# Grasshopper definition dfSlopeVectors.gh (Grasshopper 1.0.7)
# plug-ins: Docofossor

# Docofossor
# Slope Vectors
# link to: /example_DTM.xyz
path = FilePath()
dfimportxyz = ImportXYZ(MarshallingSignalParameter=path)
dfgridpoints = GridPoints(MarshallingSignalParameter=dfimportxyz)
dfslopevectors = SlopeVectors(Df=dfimportxyz)
vdis = VectorDisplay(Anchor=dfgridpoints, Vector=dfslopevectors)
